# Dynamo graph ID_PROYECTO.dyn (Dynamo 3.6.2.11575)

file_path = Filename(".\ID.xlsx")
string = StringInput("ID_PROYECTO")
all_elements_in_active_view = ElementsInView()
watch = Watch(all_elements_in_active_view)
python_script = Python(IN[0]=watch)  # CPython3
# ---------- python_script.python (173 lines) ----------
import clr

# =========================================================
# REVIT API
# =========================================================
clr.AddReference("RevitAPI")
from Autodesk.Revit.DB import *

# =========================================================
# REVIT SERVICES
# =========================================================
clr.AddReference("RevitServices")
from RevitServices.Persistence import DocumentManager

doc = DocumentManager.Instance.CurrentDBDocument

# =========================================================
# ENTRADA
# IN[0] = elementos de Revit
# =========================================================
elementos = IN[0]

if not isinstance(elementos, list):
    elementos = [elementos]

# =========================================================
# TABLA
# =========================================================
tabla = [
    ["Categoria", "Familia", "Tipo", "ID"]
]

# =========================================================
# RECORRER ELEMENTOS
# =========================================================
for elemento in elementos:

    try:
        el = UnwrapElement(elemento)

        if el is None:
            continue

        # -------------------------------------------------
        # CATEGORIA
        # -------------------------------------------------
        categoria = "Sin categoria"

        try:
            if el.Category is not None:
                categoria = el.Category.Name
        except:
            pass

        # -------------------------------------------------
        # ID
        # -------------------------------------------------
        elemento_id = ""

        try:
            elemento_id = el.Id.Value
        except:
            try:
                elemento_id = el.Id.IntegerValue
            except:
                pass

        # -------------------------------------------------
        # VALORES INICIALES
        # -------------------------------------------------
        familia = "Sin familia"
        tipo = "Sin tipo"

        # -------------------------------------------------
        # OBTENER TIPO DEL ELEMENTO
        # -------------------------------------------------
        try:
            type_id = el.GetTypeId()

            if type_id != ElementId.InvalidElementId:

                element_type = doc.GetElement(type_id)

                if element_type is not None:

                    # =====================================
                    # FAMILIA
                    # =====================================
                    try:
                        p_familia = element_type.get_Parameter(
                            BuiltInParameter.ALL_MODEL_FAMILY_NAME
                        )

                        if p_familia is not None:
                            valor = p_familia.AsString()

                            if valor:
                                familia = valor
                    except:
                        pass

                    # Si no encontró familia
                    if familia == "Sin familia":
                        try:
                            familia = element_type.FamilyName
                        except:
                            try:
                                familia = element_type.Family.Name
                            except:
                                pass

                    # =====================================
                    # TIPO
                    # =====================================
                    try:
                        p_tipo = element_type.get_Parameter(
                            BuiltInParameter.ALL_MODEL_TYPE_NAME
                        )

                        if p_tipo is not None:
                            valor_tipo = p_tipo.AsString()

                            if valor_tipo:
                                tipo = valor_tipo
                    except:
                        pass

                    # -------------------------------------
                    # MÉTODO ALTERNATIVO
                    # -------------------------------------
                    if tipo == "Sin tipo":
                        try:
                            p_tipo = element_type.get_Parameter(
                                BuiltInParameter.SYMBOL_NAME_PARAM
                            )

                            if p_tipo is not None:
                                valor_tipo = p_tipo.AsString()

                                if valor_tipo:
                                    tipo = valor_tipo
                        except:
                            pass

                    # -------------------------------------
                    # ÚLTIMO MÉTODO
                    # -------------------------------------
                    if tipo == "Sin tipo":
                        try:
                            tipo = Element.Name.GetValue(element_type)
                        except:
                            pass

        except:
            pass

        # -------------------------------------------------
        # AGREGAR FILA
        # -------------------------------------------------
        tabla.append([
            categoria,
            familia,
            tipo,
            elemento_id
        ])

    except:
        pass

# =========================================================
# SALIDA
# =========================================================
OUT = tabla
# ----------------------------------------
watch_2 = Watch(python_script)
openXMLExportExcel = Data.OpenXMLExportExcel(filePath=file_path, sheetName=string, data=watch_2)
